# Grasshopper definition Generative Urbanism - Shiraz City Street Grid.gh (Grasshopper 1.0.7)
# plug-ins: Human

crv_boundry = Curve(<curve referenced from the Rhino model>)
pipeline = GeometryPipeline(
    GroupByLayer=False,
    GroupByType=False,
    IncludeHidden=True,
    IncludeLocked=True,
    LayerFilter="Streets*",
    NameFilter="*",
    SublayerFiltering=True,
    TypeFilter=4)
boundary = BoundarySurfaces(Edges=crv_boundry)
objatts = ObjectAttributes(ObjectOrAttributes=pipeline)  # -> Name, LayerName, LayerFullPath, Color, MaterialName, LinetypeName, GroupIndices, PlotWeight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
panel = Panel("???")
panel_2 = Panel("""???

the code didn't work!""")

# ---- group: Topography
srfsplit = SurfaceSplit(Surface=boundary, Curves=pipeline)
sdivide = DivideSurface(Surface=srfsplit, UCount="25", VCount="25")  # -> simplify(graft(Points)), Normals, Parameters
pt_topography = Point([<point referenced from the Rhino model> x2])
dist = Distance(PointA=pt_topography, PointB=sdivide.Points)
sort = SortList(Keys=dist)  # -> Keys, ValuesA
item = ListItem(List=sort.Keys, Index=0, Wrap=True)

# ---- group: Topography / Remapping
bnd = Bounds(Numbers=flatten(item))
dom = ConstructDomain(DomainStart="80", DomainEnd="0")
remap = RemapNumbers(Value=item, Source=bnd, Target=dom)  # -> Mapped, Clipped

# ---- group: Topography (continued)
Z = UnitZ(Factor=remap.Mapped)
move = Move(Geometry=sdivide.Points, Motion=Z)  # -> Geometry, Transform
path_mapper = PathMapper(move.Geometry, source="{A;B}", target="{A}")
lng = ListLength(List=path_mapper)
srfgrid = SurfaceFromPoints(Points=flatten(path_mapper), UCount=lng, Interpolate=False)

# ----
offset = OffsetCurve(Curve=graft(pipeline), Distance=expr("x/2", objatts.UserDataValues), Corners=1)  # -> flatten(Curve)
offset_2 = OffsetCurve(Curve=graft(pipeline), Distance=expr("-x/2", objatts.UserDataValues), Corners=1)  # -> flatten(Curve)

end = EndPoints(Curve=offset)  # -> Start, End
end_2 = EndPoints(Curve=offset_2)  # -> Start, End
ln = Line(StartPoint=end.End, EndPoint=end_2.End)
ln_2 = Line(StartPoint=end.Start, EndPoint=end_2.Start)

srfsplit_2 = SurfaceSplit(Surface=boundary, Curves=[ln_2, ln, offset, offset_2])
edges = BrepEdges(Brep=srfsplit_2)  # -> Naked, Interior, NonManifold
join = JoinCurves(Curves=edges.Naked, Preserve=False)
area = Area(Geometry=join)  # -> Area, Centroid

srf_cp = SurfaceClosestPoint(Point=flatten(area.Centroid), Surface=graft(srfsplit_2))  # -> Point, UVPoint, Distance
sort_2 = SortList(Keys=srf_cp.Distance)  # -> Keys, ValuesA
item_2 = ListItem(List=sort_2.Keys, Index=0, Wrap=True)
smaller = SmallerThan(FirstNumber=item_2, SecondNumber="0.01")  # -> SmallerThan, OrEqualTo
cull = CullPattern(List=srfsplit_2, CullPattern=smaller.SmallerThan)
